# Grasshopper definition test_file.gh (Grasshopper 1.0.7)

# ---- group: inputs
height = Slider(2250, range=1700..3000)
small_angle = Number(85.4)
big_angle = Number(105)
crv = Curve(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)

# ----
panel = Panel(big_angle)
panel_2 = Panel(small_angle)
flip = FlipCurve(Curve=crv)  # -> Curve, Flag
rad1 = Radians(Degrees=big_angle)
rad2 = Radians(Degrees=small_angle)
line = Line(flip.Curve)
vec = Vector(line)
b1 = B2(height=height, angle=rad1)
b2 = B2(height=height, angle=rad2)
amp = Amplitude(Vector=vec, Amplitude=height)
end = EndPoints(Curve=line)  # -> Start, End

# ---- group: README generation
panel_3 = Panel("A grasshopper version control and sharing tool")
panel_4 = Panel("https://placebear.com/300/300")
summary = Panel("Makes a backpack for grasshopper binaries so that the backpack can be git version controlled alongside the gh binary. Also defines a pattern for documentation that goes along with it.")
origin_story = Panel("For a very long time I've wanted a better way to version control grasshopper files, and to document them, and to share them. Might as well kill three birds with one stone! I first started thinking about this [13 years ago](https://www.grasshopper3d.com/forum/topics/version-control?id=2985220%3ATopic%3A831264) and now")
detailed_description = Panel("TODO")
panel_5 = Panel("""Ben Doherty @notionparallax
wobble @stonk
but
don't
fall
down""")
panel_6 = Panel("""weebles
wobble
but
don't
fall
down""")
python = GhPythonScript(
    headline=panel_3,
    tiny_description=panel_3,
    tags=panel_6,
    authors=panel_5,
    headline_image_url="https://placebear.com/300/300",
    summary=summary,
    origin_story=origin_story,
    detailed_description=detailed_description)  # -> out, a; inputs tags: list, authors: list
# ---------- python: Python ----------
import ghpythonlib.components as ghcomp
import os

tag_string = ""
for t in tags:
    tag_string += "    - {}\n".format(t.strip())

author_string = ""
for a in authors:
    parts = a.split("@")
    name = parts[0]
    author_string += "    - name: {name}\n".format(name=name.strip())
    gh = ""
    if len(parts) > 1:
        gh = parts[1]
        author_string += "      github: {gh}\n".format(gh=gh.strip())


def get_filename():
    # Get the current Grasshopper document
    ghdoc = ghenv.Component.OnPingDocument()

    # Get the file path
    file_path = ghdoc.FilePath

    # Extract the filename from the file path
    file_name = os.path.basename(file_path)

    return file_name


doc = """---
tiny_description: {tiny_description}
repo_url: {repo_url}
tags:
{tag_string}
authors:
{author_string}
headline_image: {headline_image_url} # fully qualified domain name, not relative.

# NOTE: this file is autogenerated from the GH component
---

# {headline} ({filename})

![An image of what this file actually does](headline_image.PNG)
![A screenshot of the grasshopper canvas](canvas_image.png)

## Summary:

_A **very** short explanation of what this does._

{summary}

## Origin story:

_Why did this file come into being?_

{origin_story}

## Detailed description:

_A much longer explanation of what this does._

{detailed_description}

""".format(
    tag_string=tag_string,
    author_string=author_string,
    headline_image_url=headline_image_url,
    tiny_description=tiny_description,
    headline=headline,
    filename=get_filename(),
    summary=summary,
    origin_story=origin_story,
    detailed_description=detailed_description,
    repo_url=repo_url
)

print (doc)

with open("README.md", "w") as f: # no encoding="utf-8" because of dark ages python 
    f.write(doc)
# ---------- end python ----------
panel_7 = Panel(python.out)

# ----
move = Move(Geometry=end.Start, Motion=amp)  # -> Geometry, Transform
xy = XYPlane(Origin=move.Geometry)
ellipse = Ellipse(Plane=xy, Radius1=b1, Radius2=b2)  # -> Ellipse, Focus1, Focus2

# ---- group: Dot output
python_2 = GhPythonScript(trigger=ellipse.Ellipse)  # -> out, graph
# ---------- python_2: Python ----------
import Grasshopper as gh
import Grasshopper.Kernel as ghk


def get_colour(i):
    colours = [
        "blueviolet",
        "brown",
        "burlywood",
        "cadetblue",
        "chartreuse",
        "chocolate",
        "coral",
        "cornflowerblue",
        "cornsilk",
        "crimson",
        "cyan",
        "orangered",
        "orchid",
    ]
    return colours[i % len(colours)]


def make_fully_qualified_name(obj):
    node_id = obj.InstanceGuid.ToString()
    fq_name = "{0}_{1}".format(obj.NickName, node_id)
    return fq_name


def make_nick_name(obj):
    nick_name = obj.NickName
    if nick_name != obj.Name:
        nick_name = "{}\\n({})".format(nick_name, obj.Name)
    return nick_name


def make_centre_node(index, nick_name, fq_name, fontsize=20):
    return '"{}" [label="{}", fillcolor="{}", fontsize={}];\n    '.format(
        fq_name, nick_name, get_colour(index), fontsize
    )


def make_node_subgraph(index, node_id, nick_name, internal_connections_dot, params_dot):
    g = """
#{4}
subgraph "cluster_subgraph_{0}" {{
    node [style=filled];
    nodesep="0.05";
    style="rounded";
    label = "{1}";
    # Nodes
    {2}
    # Edges
    {3}
}}
""".format(
        node_id, nick_name, params_dot, internal_connections_dot, index
    )
    return g


def simple_edge(from_node="in", to_node="out", num_spaces=4, edge_label=""):
    if LABEL_EDGES and edge_label:
        label = ' [label="{}"]'.format(edge_label)
    else:
        label = ""
    edge = '"{f}" -> "{t}" {el};\n{num_spaces}'.format(
        f=from_node,
        t=to_node,
        num_spaces=" " * num_spaces,
        el=label,
    )
    edge = edge.replace('""', '"')
    print(edge)
    return edge


def generate_internal_connections(index, obj):
    fq_name = make_fully_qualified_name(obj)
    centre_label = make_centre_node(index, make_nick_name(obj), fq_name)
    params_dot = "" + centre_label
    internal_connections_dot = ""

    # Enumerate inputs
    for input_param in obj.Params.Input:
        node_id = input_param.InstanceGuid.ToString()
        node_name = '"{nick}_in_{id}"'.format(nick=input_param.NickName, id=node_id)
        params_dot += make_node_def(input_param, node_name)
        internal_connections_dot += simple_edge(
            from_node=node_name, to_node=fq_name, edge_label="r i in"
        )

    # Enumerate outputs
    for output_param in obj.Params.Output:
        node_id = output_param.InstanceGuid.ToString()
        node_name = '"{nick}_out_{id}"'.format(nick=output_param.NickName, id=node_id)
        params_dot += make_node_def(output_param, node_name)
        internal_connections_dot += simple_edge(
            from_node=fq_name, to_node=node_name, edge_label="r i out"
        )

    return internal_connections_dot, params_dot


def generate_internal_connections_sources(index, obj, value):
    node_id = obj.InstanceGuid.ToString()
    nick_name = make_nick_name(obj)
    fq_name = make_fully_qualified_name(obj)
    internal_connections_dot = ""
    params_dot = (
        '"{}" [label="{}\\nValue: {}", fillcolor="{}", fontsize=20];\n    '.format(
            fq_name, nick_name, value, get_colour(index)
        )
    )
    if obj.Sources:
        node_name = '"{nick}_in_{id}"'.format(
            nick=obj.NickName,
            id=obj.Sources[0].InstanceGuid.ToString(),
        )
        params_dot += '{} [label="in →•"];\n    '.format(node_name)
        internal_connections_dot += simple_edge(
            from_node=node_name, to_node=fq_name, edge_label="leaf i in"
        )

    if obj.Recipients:
        node_name = '"{nick}_out_{id}"'.format(nick=obj.NickName, id=node_id)
        params_dot += '{} [label="•→ out"];\n    '.format(node_name)
        internal_connections_dot += simple_edge(
            from_node=fq_name, to_node=node_name, edge_label="leaf i out"
        )

    return internal_connections_dot, params_dot


def make_node_def(input_param, node_name):
    return '{node_name} [label="{nick}\\n{type_name}"];\n    '.format(
        node_name=node_name,
        nick=input_param.NickName,
        type_name=type(input_param).__name__,
    )


def generate_connections_dot(edges_string, obj, node_id):
    edges_string += "# Connections for {}\n".format(obj.NickName)
    # Enumerate inputs
    for input_param in obj.Params.Input:
        node_name = '"{nick}_in_{id}"'.format(
            nick=input_param.NickName, id=input_param.InstanceGuid.ToString()
        )
        for source in input_param.Sources:
            source_node_name = '"{nick}_out_{id}"'.format(
                nick=source.NickName, id=source.InstanceGuid.ToString()
            )
            edges_string += simple_edge(
                source_node_name, node_name, edge_label=obj.NickName + " dot input"
            )

    # Enumerate outputs
    # I don't think we need to do this, as the outputs are already connected to the
    # recipients. Every connection has an input on one end
    # for output_param in obj.Params.Output:
    #     node_name = '"{nick}_out_{id}"'.format(
    #         nick=output_param.NickName, id=output_param.InstanceGuid.ToString()
    #     )
    #     for recipient in output_param.Recipients:
    #         recipient_node_name = '"{}_in_{}"'.format(
    #             recipient.NickName, recipient.InstanceGuid.ToString()
    #         )
    #         edges_string += simple_edge(
    #             node_name, recipient_node_name, edge_label=obj.NickName + " dot output"
    #         )

    return edges_string


# def generate_connections_dot_sources(connections_dot, obj):
#     # TODO: I don't think this does anything, remove it
#     fq_name = make_fully_qualified_name(obj)
#     for source in obj.Sources:
#         source_node_name = '"{}_out_{}"'.format(
#             source.NickName, source.InstanceGuid.ToString()
#         )
#         connections_dot += simple_edge(
#             source_node_name, fq_name, edge_label="between Source"
#         )

#     for recipient in obj.Recipients:
#         recipient_node_name = '"{}_in_{}"'.format(
#             recipient.NickName, recipient.InstanceGuid.ToString()
#         )
#         connections_dot += simple_edge(
#             fq_name, recipient_node_name, edge_label="between Recipients"
#         )

#     return connections_dot


def get_value(obj):
    try:
        # Access the value
        value = obj.VolatileData.get_Branch(0)[0]
    except:
        value = obj.VolatileData
    return value


def main():
    # Get the active Grasshopper document
    gh_doc = gh.Instances.ActiveCanvas.Document

    subgraphs = ""
    connections_dot = ""

    for index, obj in enumerate(gh_doc.Objects):
        node_id = obj.InstanceGuid.ToString()
        nick_name = make_nick_name(obj)
        print(
            "{} | Object: {}, Type: {} GUID: {}".format(
                index, nick_name, type(obj).__name__, node_id
            )
        )

        if hasattr(obj, "Params"):
            internal_connections_dot, params_dot = generate_internal_connections(
                index, obj
            )
            connections_dot = generate_connections_dot(connections_dot, obj, node_id)
            g = make_node_subgraph(
                index, node_id, nick_name, internal_connections_dot, params_dot
            )
            subgraphs += g

        elif hasattr(obj, "Sources"):
            value = get_value(obj)
            internal_connections_dot, params_dot = (
                generate_internal_connections_sources(index, obj, value)
            )
            # connections_dot = generate_connections_dot_sources(connections_dot, obj)
            g = make_node_subgraph(
                index, node_id, nick_name, internal_connections_dot, params_dot
            )
            subgraphs += g

        else:
            print("some other kind of object encountered", obj)
            # This is where we'll handle things like groups

    graph = """digraph G {{
    rankdir = LR;
    # Subgraphs
    {0}
    # Generated Connections
    {1}
    # Manually Connected Connections
    # These are the connections that I've manually created that actually connect the graph the way it ought to be connected.
    # These should be automatically generated, but I can't work out why they're not yet.
    #
}}""".format(
        subgraphs, connections_dot
    )

    return graph


LABEL_EDGES = False  # Set to True to label the edges, very handy for debugging
graph = main()
# ---------- end python_2 ----------
dot_panel = Panel(python_2.graph)

# ---- group: Canvas capture
python_3 = GhPythonScript(guard=Toggle(False), trigger=ellipse.Ellipse)  # -> out, a; inputs guard: Boolean
# ---------- python_3: Python ----------
__author__ = "bdoherty"
__version__ = "2024.09.03"

import rhinoscriptsyntax as rs
import Grasshopper as gh
import os
import ghpythonlib.components as ghcomp
import System.Drawing.Color as sys_colour
import System.Drawing.Point as sys_pt

ghdoc = ghenv.Component.OnPingDocument()
canvas = gh.GH_InstanceServer.ActiveCanvas


def zoom_to_extents():
    # Get the current Grasshopper document
    ghdoc = ghenv.Component.OnPingDocument()

    # Get the active Grasshopper canvas
    canvas = gh.GH_InstanceServer.ActiveCanvas

    # Get the bounding box of all objects in the document
    limitToSelection = False
    bbox = ghdoc.BoundingBox(limitToSelection)

    # Get the canvas viewport
    viewport = canvas.Viewport

    # Set the viewport target to the center of the bounding box
    center = get_bbox_centre(bbox)
    viewport.Target = center

    zoom_factor = get_zoom_factor(bbox, viewport)

    # Apply the zoom factor
    viewport.Zoom = zoom_factor

    # Refresh the canvas
    canvas.Refresh()


def get_bbox_centre(bbox):
    center_x = bbox.X + bbox.Width / 2
    # Calculate the center of the bounding box
    center_y = bbox.Y + bbox.Height / 2
    center = sys_pt(center_x, center_y)
    return center


def get_zoom_factor(bbox, viewport):
    """Calculate the zoom factor to fit the bounding box"""
    zoom_factor_x = viewport.Width / bbox.Width
    zoom_factor_y = viewport.Height / bbox.Height
    zoom_factor = min(zoom_factor_x, zoom_factor_y)
    return zoom_factor


def save_canvas_image(ghdoc, zoom_to_extents):
    """Save the canvas image to the same directory as the Grasshopper file
    E.g. from here: https://www.grasshopper3d.com/forum/topics/save-grashopper-canvas-as-picture-with-python?commentId=2985220%3AComment%3A1798948
    """

    # Get the file path
    file_path = ghdoc.FilePath
    directory_path = os.path.dirname(file_path)

    mode = gh.GUI.Canvas.GH_CanvasMode.Export
    # This, below, just makes a tile
    # vp = gh.GUI.Canvas.GH_Viewport()
    # colour = sys_colour.White
    # bmp = gh.Instances.ActiveCanvas.GenerateHiResImageTile(vp, colour)

    # And this, below, captures the part that's currently on the screen
    # I don't think there's a way to capture the whole canvas
    # But maybe there's a way to trigger a zoom to extents first.
    zoom_to_extents()
    bmp = gh.Instances.ActiveCanvas.GetCanvasScreenBuffer(mode)
    path = os.path.join(directory_path, "canvas_image.png")
    print("Saving canvas image to {}".format(path))
    bmp.Save(path)


if not guard:
    save_canvas_image(ghdoc, zoom_to_extents)
# ---------- end python_3 ----------
panel_8 = Panel(python_3.out)

# ==== cluster B2
height = ClusterInput()
angle = ClusterInput()
b = GhPythonScript(height=height, angle=angle)  # -> base
# ---------- b: Python ----------
__author__ = "bdoherty"
__version__ = "2024.06.06"

#import rhinoscriptsyntax as rs
import math

hyp = height/math.cos(angle/2)

base = math.sqrt(hyp**2 - height**2)

a = base
# ---------- end b ----------
base = ClusterOutput(b)
