# Grasshopper definition test_file.gh (Grasshopper 1.0.7)

height = Slider(2250, range=1700..3000)
small_angle = Number(85.4)
big_angle = Number(105)
crv = Curve(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)
panel = Panel(big_angle)
panel_2 = Panel(small_angle)
flip = FlipCurve(Curve=crv)  # -> Curve, Flag
rad = Radians(Degrees=big_angle)
rad_2 = Radians(Degrees=small_angle)
addition = Addition(A=big_angle, B=small_angle)
line = Line(flip.Curve)
vec = Vector(line)
res = Panel(addition)
b = B(height=height, angle=rad)
b_2 = B(height=height, angle=rad_2)
amp = Amplitude(Vector=vec, Amplitude=height)
end = EndPoints(Curve=line)  # -> Start, End
move = Move(Geometry=end.Start, Motion=amp)  # -> Geometry, Transform
xy = XYPlane(Origin=move.Geometry)
ellipse = Ellipse(Plane=xy, Radius1=b, Radius2=b_2)  # -> Ellipse, Focus1, Focus2
python = GhPythonScript(x=ellipse.Ellipse)  # -> out, graph
# ---------- python: Python ----------
import Grasshopper as gh
import Grasshopper.Kernel as ghk

def get_colour(i):
    colours = [
        "blueviolet",
        "brown",
        "burlywood",
        "cadetblue",
        "chartreuse",
        "chocolate",
        "coral",
        "cornflowerblue",
        "cornsilk",
        "crimson",
        "cyan",
        "orangered",
        "orchid"
    ]
    return colours[i % len(colours)]

# Get the active Grasshopper document
gh_doc = gh.Instances.ActiveCanvas.Document

subgraphs = ""
connections_dot = ""

for index, obj in enumerate(gh_doc.Objects):
    node_id = obj.InstanceGuid.ToString()
    nn = obj.NickName
    if nn != obj.Name:
        nn = "{}\\n({})".format(nn, obj.Name)
    fq_name = '{0}_{1}'.format(obj.NickName, node_id)
    print "{} | Object: {}, Type: {} GUID: {}".format(index, nn, type(obj).__name__, node_id)
    
    if hasattr(obj, 'Params'):
        # Enumerate inputs
        internal_connections_dot = ""
        params_dot = '"{}" [label="{}", fillcolor="{}", fontsize=20];\n    '.format(fq_name, nn, get_colour(index))
        for input_param in obj.Params.Input:
            node_name = '"{}_in_{}"'.format(input_param.NickName, node_id)
            params_dot += '{} [label="{} \\n{}"];\n    '.format(node_name, input_param.NickName, type(input_param).__name__)
            internal_connections_dot += '{} -> "{}";\n    '.format(node_name, fq_name)
            
            # Add connections from sources to this input
            for source in input_param.Sources:
                source_node_name = '"{}_out_{}"'.format(source.NickName, source.InstanceGuid.ToString())
                connections_dot += '{} -> {};\n    '.format(source_node_name, node_name)
        
        # Enumerate outputs
        for output_param in obj.Params.Output:
            node_name = '"{}_out_{}"'.format(output_param.NickName, node_id)
            params_dot += '{} [label="{} \\n{}"];\n    '.format(node_name, output_param.NickName, type(output_param).__name__)
            internal_connections_dot += '"{}" -> {};\n    '.format(fq_name, node_name)
            
            # Add connections from this output to recipients
            for recipient in output_param.Recipients:
                recipient_node_name = '"{}_in_{}"'.format(recipient.NickName, recipient.InstanceGuid.ToString())
                connections_dot += '{} -> {};\n    '.format(node_name, recipient_node_name)
        
        subgraphs += """
subgraph "cluster_subgraph_{0}" {{
    node [style=filled];
    nodesep="0.05";
    style="rounded";
    label = "{1}";
    # Nodes
    {2}
    # Edges
    {3}
    #{4}
  }}
""".format(node_id, nn, params_dot, internal_connections_dot, index)
  
  
    else:
        
        # print("____does not have Params property")
        if hasattr(obj, 'Sources'):
            # Access the value
            try:
                value = obj.VolatileData.get_Branch(0)[0]
            except:
                value = obj.VolatileData
            print("____Value: {}".format(value))
            internal_connections_dot = ""
            params_dot = '"{}" [label="{}\\nValue: {}", fillcolor="{}", fontsize=20];\n    '.format(fq_name, nn, value, get_colour(index))
            if obj.Sources:
                params_dot += '"{0}_in" [label="in →•"];'.format(fq_name)
                internal_connections_dot += '"{0}_in" -> "{0}";\n    '.format(fq_name)
            if obj.Recipients:
                params_dot += '"{0}_out" [label="out •→"];'.format(fq_name)
                internal_connections_dot += '"{0}" -> "{0}_out";\n    '.format(fq_name)

            # Inspect connections
            print "Sources", len(obj.Sources), "Recipients", len(obj.Recipients)
            for source in obj.Sources:
                print("____Connected to: {}, Type: {}".format(source.NickName, type(source).__name__))
                source_node_name = '"{}_out_{}"'.format(source.NickName, source.InstanceGuid.ToString())
                connections_dot += '{} -> "{}_in";\n    '.format(source_node_name, fq_name)

            for recipient in obj.Recipients:
                print("____Recipient: {}, Type: {}".format(recipient.NickName, type(recipient).__name__))
                recipient_node_name = '"{}_in_{}"'.format(recipient.NickName, recipient.InstanceGuid.ToString())
                connections_dot += '"{}_out" -> {};\n    '.format(fq_name, recipient_node_name)
                
            subgraphs += """
subgraph "cluster_subgraph__{0}" {{
    node [style=filled];
    nodesep="0.05";
    style="rounded";
    label = "{1}";
    # Nodes
    {2}
    # Edges
    {3}
    #{4}
  }}
""".format(node_id, nn, params_dot, internal_connections_dot, index)

graph = """digraph G {{
    rankdir = LR;
    
    {0}
    
    {1}
}}""".format(subgraphs, connections_dot)

print(graph)
# ---------- end python ----------
dot_panel = Panel(python.graph)

# ==== cluster B
height = ClusterInput()
angle = ClusterInput()
b = GhPythonScript(height=height, angle=angle)  # -> base
# ---------- b: Python ----------
__author__ = "bdoherty"
__version__ = "2024.06.06"

#import rhinoscriptsyntax as rs
import math

hyp = height/math.cos(angle/2)

base = math.sqrt(hyp**2 - height**2)

a = base
# ---------- end b ----------
base = ClusterOutput(b)
